# Grasshopper definition euclidean_geometry.gh (Grasshopper 1.0.7)

# This program demonstrates how to combine traditional euclidean geometry and turtle geometry.
# Circle is generated with euclidean geometry. Spikes are generated with turtle geometry.
# More information: https://handandmachine.org/projects/extruder_turtle_rhino/examples.html
number_slider = Slider(20, range=0..100)
python = GhPythonScript()  # -> out, file
# ---------- python: Python ----------
# script to generate a file for .gcode

import rhinoscriptsyntax as rs

filter = "GCode (*.gcode)|*.gcode|All Files (*.*)|*.*||"
file = rs.SaveFileName("", filter)
# ---------- end python ----------
python_2 = GhPythonScript(file=python.file, radius=number_slider)  # -> out, lines, turtle, print_bed
# ---------- python_2: Python ----------
import rhinoscriptsyntax as rs
import extruder_turtle
from extruder_turtle import *
import math

# set up the turtle and associate the turtle with a specific printer
t = ExtruderTurtle()
t.setup(filename=file, printer = "eazao")

# print out important printer parameters
t.print_printer_information()

# main part of program
r = radius

for i in range (0,361):
    # euclidean geometry: circle
    x = r * math.cos(math.radians(i))
    y = r * math.sin(math.radians(i))
    t.set_position(x,y) # set the turtle's position using coordinates
    if (i> 0 and i%10 == 0):
        # turtle geometry: spikes
        t.right(90)
        t.forward(5)
        t.back(5)
        t.left(90)
        
        
# visualize the turtle's location and position
turtle = t.draw_turtle()

# visualize the printer's print bed
print_bed = t.draw_print_bed()

# get the path the turtle has traveled to visualize in Rhino
lines = t.get_lines()

# close the generated .gcode file
t.finish()
# ---------- end python_2 ----------
panel = Panel(python_2.out)
