# Grasshopper definition polygon.gh (Grasshopper 1.0.7)

trigger = Trigger(Interval=-1, TimerInterval=5, Target=python)  # disabled
size = Slider(30, range=0..100)
number_sides = Slider(3, range=3..10)
python = GhPythonScript()  # -> out, file
# ---------- python: Python ----------
# script to generate a file for .gcode

import rhinoscriptsyntax as rs

filter = "GCode (*.gcode)|*.gcode|All Files (*.*)|*.*||"
file = rs.SaveFileName("", filter)
# ---------- end python ----------
python_2 = GhPythonScript(file=python.file, size=size, number_sides=number_sides)  # -> out, lines, turtle, print_bed; inputs number_sides: Int32
# ---------- python_2: Python ----------
import rhinoscriptsyntax as rs
import extruder_turtle
from extruder_turtle import *
import turtle_utilities as tu

# set up the turtle
t = ExtruderTurtle()
t.setup(x=0, y=0, z=0.0, filename=file, printer = "super")

for i in range(number_sides):
    t.forward(size)
    t.right(360/number_sides)


# visualize the turtle's location and position
turtle = t.draw_turtle()
print_bed = t.draw_print_bed()

# visualize the turtle's path
lines = t.get_lines()

# close the generated .gcode file
t.finish()
# ---------- end python_2 ----------
