# Grasshopper definition starting_example.gh (Grasshopper 1.0.7)

# This is a simple program that demonstrates how to get started with the Extruder Turtle Library
# It generates a gcode file that follows the path of the turtle.
# More information: https://handandmachine.org/projects/extruder_turtle_rhino/examples.html
python = GhPythonScript()  # -> out, file
# ---------- python: Python ----------
# script to generate a file for .gcode

import rhinoscriptsyntax as rs

filter = "GCode (*.gcode)|*.gcode|All Files (*.*)|*.*||"
file = rs.SaveFileName("", filter)
# ---------- end python ----------
panel = Panel(python.file)
python_2 = GhPythonScript(file=python.file)  # -> out, lines, turtle, print_bed
# ---------- python_2: Python ----------
import rhinoscriptsyntax as rs
import extruder_turtle
from extruder_turtle import *


# set up the turtle and associate the 
# turtle with a specific printer
t = ExtruderTurtle()
t.setup(filename=file, printer = "civil")

# print out important printer parameters
t.print_printer_information()


# do your turtle programming here
# this code draws a triangle



for j in range (10):
    for i in range (4):
        t.forward(100) # units are in mm
        t.right(90)
    t.lift(10)


# visualize the turtle's location 
# and position
turtle = t.draw_turtle()

# visualize the printer's print bed
print_bed = t.draw_print_bed()

# get the path the turtle has 
# traveled to visualize in Rhino
lines = t.get_lines()

t.volume_of_path()


# close the generated .gcode file
t.finish()
# ---------- end python_2 ----------
line = Line(python_2.lines)
srf = Surface(python_2.turtle)
panel_2 = Panel(python_2.out)
