# Grasshopper definition turtle_slice.gh (Grasshopper 1.0.7)

# ----
# Another sample shape
radius_top = Slider(46, range=1..100)
radius_mid = Slider(73, range=3..100)
rotation = Slider(3, range=3..100)
geo = Geometry(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)
height = Slider(100, range=3..100)
radius_bottom = Slider(36, range=3..100)
python = GhPythonScript(height=height, radius_top=radius_top, radius_mid=radius_mid, radius_bottom=radius_bottom, rotation=rotation, curve=geo)  # -> out, points, polygons, curves; inputs curve: Curve
# ---------- python: Python ----------
# code required so that library reloads appropriately
# must be above other import statements
import sys
import operator as op
to_delete = list()
for module in sys.modules:
    if "extruder_turtle" in module:
      to_delete.append(module)
    if "turtle_utilities" in module:
      to_delete.append(module)
for module in to_delete:
    sys.modules.pop(module)
    
import rhinoscriptsyntax as rs
import extruder_turtle  
import turtle_utilities as tu
from extruder_turtle import *


reload(extruder_turtle)

tu.scale(curve,radius_bottom/50)
curve2 = tu.translate_copy(curve,0,0,height/2)
tu.scale(curve2,radius_mid/50)
tu.rotate(curve2,rotation/2)
curve3 = tu.translate_copy(curve,0,0,height)
tu.scale(curve3,radius_top/50)
tu.rotate(curve3,rotation)

curves = []
curves.append(curve)
curves.append(curve2)
curves.append(curve3)
# ---------- end python ----------
loft = Loft(Curves=python.curves, Options={Adjust=False, Closed=False, LoftEnds=0, LoftSimp=0, LoftType=0, Rebuild=10, Refit=0.01})
cap = CapHoles(Brep=loft)

# ----
# Sample shape to slice
radius_bottom_2 = Slider(36, range=3..100)
radius_top_2 = Slider(46, range=1..100)
radius_mid_2 = Slider(73, range=3..100)
height_2 = Slider(100, range=3..100)
facets = Slider(5, range=3..20)
python_2 = GhPythonScript(facets=facets, height=height_2, radius_top=radius_top_2, radius_mid=radius_mid_2, radius_bottom=radius_bottom_2)  # -> out, points, polygons, curves; inputs facets: Int32
# ---------- python_2: Python ----------
__author__ = "Leah"

import rhinoscriptsyntax as rs
import math

def polyPoints (z, r):
    points = []
    for i in range (0,facets+1):
        angle = i*360/facets
        x = r*math.cos(math.radians(angle))
        y = r*math.sin(math.radians(angle))
        points.append(rs.CreatePoint(x,y,z))
    return points
    
def polygon(z, r):
    points = polyPoints(z,r)
    polygon = rs.AddPolyline(points)
    return polygon

def curvePoly(z, r):
    points = polyPoints(z,r)
    curve = rs.AddCurve(points,2)
    return curve

polygons = []
polygons.append(polygon(0,radius_bottom))
polygons.append(polygon(height/2,radius_mid))
polygons.append(polygon(height,radius_top))

curves = []
curves.append(curvePoly(0,radius_bottom))
curves.append(curvePoly(height/2,radius_mid))
curves.append(curvePoly(height,radius_top))
    
def cosPoints(z,in_r,a,b):
    points = []
    for i in range (0,360+1):
        r = in_r+a+a*math.cos(math.radians(i)*b)
        x = r*math.cos(math.radians(i))
        y = r*math.sin(math.radians(i))
        points.append(rs.CreatePoint(x,y,z))
    return points

def cosPoly(z,in_r,a,b):
    points = cosPoints(z,in_r,a,b)
    curve = rs.AddCurve(points)
    curve = rs.CloseCurve(curve,1)
    return curve

curves = []
curves.append(cosPoly(0,radius_bottom,2,facets))
curves.append(cosPoly(height/2,radius_mid,2,facets))
curves.append(cosPoly(height,radius_top,2,facets))
# ---------- end python_2 ----------
loft_2 = Loft(Curves=python_2.curves, Options={Adjust=False, Closed=False, LoftEnds=0, LoftSimp=0, LoftType=0, Rebuild=10, Refit=0.01})
cap_2 = CapHoles(Brep=loft_2)

trigger = Trigger(Interval=-1000, TimerInterval=1000, Target=python_3)
python_3 = GhPythonScript()  # -> out, file
# ---------- python_3: Python ----------
import rhinoscriptsyntax as rs

filter = "GCode (*.gcode)|*.gcode|All Files (*.*)|*.*||"
file = rs.SaveFileName("", filter)
# ---------- end python_3 ----------
dam = DataDam(DataB=python_3.file, BufferDelay=10000000, BufferMode=0)  # -> DataB, DataA
python_4 = GhPythonScript(filename=dam.DataB, shape=dam.DataA)  # -> out, lines, turtle; inputs shape: Brep
# ---------- python_4: Python ----------
# code required so that library reloads appropriately
# must be above other import statements
import sys
import operator as op
to_delete = list()
for module in sys.modules:
    if "extruder_turtle" in module:
      to_delete.append(module)
    if "turtle_utilities" in module:
      to_delete.append(module)
for module in to_delete:
    sys.modules.pop(module)
    
import rhinoscriptsyntax as rs
import extruder_turtle  
import turtle_utilities as tu
from extruder_turtle import *

reload(extruder_turtle)

# set up the turtle
t = ExtruderTurtle()
t.setup(x=0, y=0, z=0.0, filename=filename, printer = "eazao")

layer_height = t.get_layer_height()
print("standard layer height is: " +str(layer_height))

# slice the shape
# this function generates a turtle path that 
# follows the outer perimeter of the shape
slices = tu.slice_with_turtle(t, shape, layer_height=layer_height, walls = 1, spiral_up = True)

# visualize the turtle's path
lines = t.get_lines()

# close the generated .gcode file
t.finish()
# ---------- end python_4 ----------
